# Grasshopper definition kuka_prc_test.ghx (Grasshopper 1.0.7)
# plug-ins: KUKA|prc - parametric robot control

# ----
# General
# Setting
number_slider = Slider(0, range=0..1)
initial_vel_m_sec = Panel("0.01")
kr6_10_r1100_2 = AgilusKR610R11002Robot(infiniterot=False)
iteration = Panel("2")
filename = Panel("test")
save = BooleanToggle(False)
python = GhPythonScript(prefix=filename, iter=iteration, update=save)  # -> out, filename
# ---------- python: Python ----------
__author__ = "trtku"
__version__ = "2022.09.26"

from datetime import datetime as dt

today = str(dt.today()).translate(None, '-')
today = today.split(' ')[0]

filename = prefix + iter + "_" + today
# ---------- end python ----------

# ----
# Scene
# Planning
mesh = Mesh([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])
mesh_2 = Mesh(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)
mesh_3 = Mesh(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)

list = ValueList({"iter 01": 0, "iter 02": 1}, selected="iter 01")
path = DataPath("{0}")
path_2 = DataPath("{1}")
default_start_position = Panel("""0
-90
90
0
0
0
0
0
0
0""")

# ----
# Target
# Plane03
vel_to_ths_plane_m_sec = Panel("0.01")
safe_distance = Slider(100, range=0..1000)
Z = UnitZ(Factor=safe_distance)
num = Number(vel_to_ths_plane_m_sec)

# ----
# Target
# Plane01
number_slider_2 = Slider(360, range=-1000..1000)
x_angle = Slider(0, range=-180..180)
y_angle = Slider(-90, range=-180..180)
z_angle = Slider(0, range=-180..180)
vel_to_ths_plane_m_sec_2 = Panel("0.01")
rad = Radians(Degrees=x_angle)
rad_2 = Radians(Degrees=y_angle)
rad_3 = Radians(Degrees=z_angle)
X = UnitX(Factor=1)
Y = UnitY(Factor=1)
num_2 = Number(vel_to_ths_plane_m_sec_2)

# ----
# Tool
# Settings
tool_height = Panel("555")
tool_mound_radius = Panel("40")
mesh_4 = Mesh(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)
custom_tool = CustomToolKUKAPrc(
    CustomToolGeometry=mesh_4,
    toolid=4,
    toolvala=0,
    toolvalb=0,
    toolvalc=0,
    toolvalx=0,
    toolvaly=0,
    toolvalz=0,
    valuesset=True)

# ----
# Initial
# Plane
number_slider_3 = Slider(633, range=-1000..1000)
x_angle_2 = Slider(0, range=-180..180)
y_angle_2 = Slider(-90, range=-180..180)
z_angle_2 = Slider(0, range=-180..180)
pt = ConstructPoint(XCoordinate=number_slider_3, YCoordinate=Slider(0, range=-1000..1000), ZCoordinate=Slider(1000, range=-1000..1000))
rad_4 = Radians(Degrees=x_angle_2)
rad_5 = Radians(Degrees=y_angle_2)
rad_6 = Radians(Degrees=z_angle_2)
X_2 = UnitX(Factor=1)
Y_2 = UnitY(Factor=1)
pl = ConstructPlane(Origin=pt, XAxis=expr("-x", X_2), YAxis=Y_2)
deplane = DeconstructPlane(Plane=pl)  # -> Origin, XAxis, YAxis, ZAxis
subtraction = Subtraction(A=tool_height, B=tool_mound_radius)
rot3d = Rotate3D(Geometry=pl, Angle=rad_4, Center=deplane.Origin, Axis=deplane.XAxis)  # -> Geometry, Transform
deplane_2 = DeconstructPlane(Plane=rot3d.Geometry)  # -> Origin, XAxis, YAxis, ZAxis
rot3d_2 = Rotate3D(Geometry=rot3d.Geometry, Angle=rad_5, Center=deplane_2.Origin, Axis=deplane_2.YAxis)  # -> Geometry, Transform
deplane_3 = DeconstructPlane(Plane=rot3d_2.Geometry)  # -> Origin, XAxis, YAxis, ZAxis
rot3d_3 = Rotate3D(Geometry=rot3d_2.Geometry, Angle=rad_6, Center=deplane_3.Origin, Axis=deplane_3.ZAxis)  # -> Geometry, Transform
deplane_4 = DeconstructPlane(Plane=rot3d_3.Geometry)  # -> Origin, XAxis, YAxis, ZAxis
multiplication = Multiplication(A=deplane_4.ZAxis, B=subtraction)
move = Move(Geometry=rot3d_3.Geometry, Motion=multiplication)  # -> Geometry, Transform
deplane_5 = DeconstructPlane(Plane=move.Geometry)  # -> Origin, XAxis, YAxis, ZAxis
data = Data(deplane_5.Origin)
pln = Plane(rot3d_3.Geometry)

tool_bottom_plane = Panel(data)

addition = Addition(A=Slider(-244, range=-1000..1000), B=tool_height)
pt_2 = ConstructPoint(XCoordinate=number_slider_2, YCoordinate=Slider(-375, range=-1000..1000), ZCoordinate=addition)
pl_2 = ConstructPlane(Origin=pt_2, XAxis=expr("-x", X), YAxis=Y)
deplane_6 = DeconstructPlane(Plane=pl_2)  # -> Origin, XAxis, YAxis, ZAxis
subtraction_2 = Subtraction(A=tool_height, B=tool_mound_radius)
rot3d_4 = Rotate3D(Geometry=pl_2, Angle=rad, Center=deplane_6.Origin, Axis=deplane_6.XAxis)  # -> Geometry, Transform
deplane_7 = DeconstructPlane(Plane=rot3d_4.Geometry)  # -> Origin, XAxis, YAxis, ZAxis
rot3d_5 = Rotate3D(Geometry=rot3d_4.Geometry, Angle=rad_2, Center=deplane_7.Origin, Axis=deplane_7.YAxis)  # -> Geometry, Transform
deplane_8 = DeconstructPlane(Plane=rot3d_5.Geometry)  # -> Origin, XAxis, YAxis, ZAxis
rot3d_6 = Rotate3D(Geometry=rot3d_5.Geometry, Angle=rad_3, Center=deplane_8.Origin, Axis=deplane_8.ZAxis)  # -> Geometry, Transform
deplane_9 = DeconstructPlane(Plane=rot3d_6.Geometry)  # -> Origin, XAxis, YAxis, ZAxis
multiplication_2 = Multiplication(A=deplane_9.ZAxis, B=subtraction_2)
move_2 = Move(Geometry=rot3d_6.Geometry, Motion=multiplication_2)  # -> Geometry, Transform
deplane_10 = DeconstructPlane(Plane=move_2.Geometry)  # -> Origin, XAxis, YAxis, ZAxis
data_2 = Data(deplane_10.Origin)
pln_2 = Plane(rot3d_6.Geometry)

# ----
# Approach
# Plane
pln_3 = Plane(pln_2)
safe_distance_2 = Slider(641, range=0..1000)
vel_to_ths_plane_m_sec_3 = Panel("0.01")
Z_2 = UnitZ(Factor=safe_distance_2)
move_3 = Move(Geometry=pln_3, Motion=Z_2)  # -> Geometry, Transform
pln_4 = Plane(move_3.Geometry)
num_3 = Number(vel_to_ths_plane_m_sec_3)

# ----
# Target
# Plane02
vel_to_ths_plane_m_sec_4 = Panel("0.01")
pln_5 = Plane(pln_2)
safe_distance_3 = Slider(100, range=0..1000)
Z_3 = UnitZ(Factor=safe_distance_3)
move_4 = Move(Geometry=pln_5, Motion=Z_3)  # -> Geometry, Transform
pln_6 = Plane(move_4.Geometry)
num_4 = Number(vel_to_ths_plane_m_sec_4)

pln_7 = Plane(pln_6)
move_5 = Move(Geometry=pln_7, Motion=Z)  # -> Geometry, Transform
pln_8 = Plane(move_5.Geometry)

merge = Merge(Data1=mesh, Data2=mesh_2, Data3=mesh_3, Data4=mesh_4)
merge_2 = Merge(Data1=pln, Data2=initial_vel_m_sec)  # -> graft(Result)
merge_3 = Merge(Data1=pln_8, Data2=num)  # -> graft(Result)
merge_4 = Merge(Data1=pln_4, Data2=num_3)  # -> graft(Result)
merge_5 = Merge(Data1=pln_2, Data2=num_2)  # -> graft(Result)
merge_6 = Merge(Data1=pln_6, Data2=num_4)  # -> graft(Result)
merge_7 = Merge(Data1=merge_6, Data2=merge_3)  # -> simplify(Result)
merge_8 = Merge(Data1=merge_2, Data2=merge_4, Data3=merge_5, Data4=merge_6)  # -> simplify(Result)
filter = StreamFilter(Gate=list, Stream0=merge_8, Stream1=merge_7)
panel = Panel(filter)
branch = TreeBranch(Tree=filter, Path=path, MaintainPaths=True)
branch_2 = TreeBranch(Tree=filter, Path=path_2, MaintainPaths=True)
lin_move = LINearMovementKUKAPrc(TargetAsPlane=branch, Speed=branch_2, extaxenabled=False)
kuka_prc = KUKAPrcCORE(
    SimulationSlider=number_slider,
    KUKAPrcCommands=lin_move,
    Tool=custom_tool,
    Robot=kr6_10_r1100_2,
    CollisionGeometry=merge,
    SaveToggle=save,
    Filename=python.filename,
    PRC_BaseExpose=False,
    PRC_SaveNameExpose=True,
    PRCsettings="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")  # -> RobotGeometry, AnalysisOutput
